# Dynamo graph dynamoFamily.DYN (Dynamo 1.3.4.6666)

# group: GET PARAMETER
select_model_element = DSModelElementSelection()  # 1 picked in the model
type = FamilyInstance.Type(select_model_element)
code_block = CodeBlock()
# ---------- code_block.designscript (20 lines) ----------
"WIDTH";
"LENGTH";
"HEIGHT";
"HEIGHT AFF";
"CLEARANCE RIGHT";
"CLEARANCE LEFT";
"CLEARANCE FRONT";
"CLEARANCE BELOW";
"CLEARANCE BACK";
"CLEARANCE ABOVE";
"CLEARANCE RIGHT";
"SPEC SECTION";
"EQ ID #";
"Description";
"FURNISH INSTALL";
"Amps";
"Phase";
"Voltage";
"Horse Power";
"Electrical Remarks";
# ----------------------------------------
getParameterValueByName = Element.GetParameterValueByName(element=select_model_element, parameterName=code_block.out14)
getParameterValueByName_2 = Element.GetParameterValueByName(element=type, parameterName=code_block.out1)

# group: Set Parameter
setParameterByName = Element.SetParameterByName(element=type, parameterName=code_block.out0)  # unwired: value
setParameterByName_2 = Element.SetParameterByName(element=type, parameterName=code_block.out1)  # unwired: value
setParameterByName_3 = Element.SetParameterByName(element=type, parameterName=code_block.out2)  # unwired: value

code_block_2 = CodeBlock { "MDG MEW"; }
code_block_3 = CodeBlock { 2; }
code_block_4 = CodeBlock { " MEW.xlsm"; }

# group: excel dynamic path
string = StringInput("O:\MASTER ECS FILES")
string_2 = StringInput("\")
getParameterValueByName_3 = Element.GetParameterValueByName(element=type, parameterName=code_block.out12)
concat = String.Concat(string, string_2, getParameterValueByName_3, code_block_4)
code_block_5 = CodeBlock { " MEW_TEST_DYNAMO.xlsm"; }
watch = Watch(getParameterValueByName_3)

code_block_6 = CodeBlock { " MEW.xlsx"; }
concat_2 = String.Concat(string, string_2, getParameterValueByName_3, code_block_6)
python_script = Python(IN[0]=concat, IN[1]=concat_2)
# ---------- python_script.python (18 lines) ----------
import clr
clr.AddReference('ProtoGeometry')
from Autodesk.DesignScript.Geometry import *
#The inputs to this node will be stored as a list in the IN variables.

import sys
sys.path.append("C:\Program Files (x86)\IronPython 2.7\Lib")

import os.path
a = IN[0]
b = IN[1]
c = os.path.exists(a)


if c == True :
	OUT = a
else:
	OUT = b
# ----------------------------------------
watch_2 = Watch(python_script)
fromPath = FileObject(watch_2)  # "File.FromPath"
code_block_7 = CodeBlock { "Datasheet"; }
readFromFile = Excel.ReadFromFile(file=fromPath, sheetName=code_block_7)
transpose = List.Transpose(readFromFile)
code_block_8 = CodeBlock { 16; }
getItemAtIndex = List.GetItemAtIndex(list=transpose, index=code_block_8)
code_block_9 = CodeBlock { 3; }

# group: WIDTH FROM EXCEL
code_block_10 = CodeBlock { 23; }
getItemAtIndex_2 = List.GetItemAtIndex(list=getItemAtIndex, index=code_block_9)

watch_3 = Watch(getItemAtIndex_2)
to_number_python = Python(IN[0]=watch_3)
# ---------- to_number_python.python (5 lines) ----------
data = IN[0]

data = int(data)

OUT=data
# ----------------------------------------
code_block_11 = CodeBlock { 18; }
getItemAtIndex_3 = List.GetItemAtIndex(list=transpose, index=code_block_11)

# group: HEIGHT FROM EXCEL
code_block_12 = CodeBlock { 24; }
getItemAtIndex_4 = List.GetItemAtIndex(list=getItemAtIndex_3, index=code_block_9)

watch_4 = Watch(getItemAtIndex_4)
to_number_python_2 = Python(IN[0]=watch_4)  # same code as to_number_python

# group: Converting Units
convert_between_units = DynamoConvert(to_number_python, conversionMetric=Length, conversionFrom=Inches, conversionTo=Feet)
convert_between_units_2 = DynamoConvert(to_number_python_2, conversionMetric=Length, conversionFrom=Inches, conversionTo=Feet)
convert_between_units_3 = DynamoConvert(conversionMetric=Length, conversionFrom=Inches, conversionTo=Feet)

categories = Categories("MechanicalEquipment")
all_elements_of_category = ElementsOfCategory(categories)
watch_5 = Watch(getParameterValueByName)
watch_6 = Watch(getParameterValueByName_2)

# group: Read from excel
watch_7 = Watch()  # unwired: arg0
boolean = BoolSelector(true)
code_block_13 = CodeBlock { "MDG MEW"; }
boolean_2 = BoolSelector(true)
code_block_14 = CodeBlock { "C23"; "C25"; }
read_excel = Custom[Read Excel](filePath=watch_7, runIt=boolean, sheetName=code_block_13, byColumn=boolean_2, origin=code_block_14.out0, extent=code_block_14.out1)  # This node will read an excel file. You can read an entore sheet contents, read from specific origin cell, read only specific range, or do all of the former for multiple sheets at the same time.

string_3 = StringInput("Z:\ADMIN\Replica\17 Revit")
exists = File.Exists()  # unwired: arg0
fromPath_2 = FileObject()  # "File.FromPath"; unwired: arg0
fromPath_3 = FileObject()  # "File.FromPath"; unwired: arg0
formula = Formula("IF(X,Y,Z)", X=exists, Y=fromPath_2, Z=fromPath_3)
code_block_15 = CodeBlock { 17; }
getItemAtIndex_5 = List.GetItemAtIndex(list=transpose, index=code_block_15)

# group: Amps FROM EXCEL
code_block_16 = CodeBlock { 28; }
getItemAtIndex_6 = List.GetItemAtIndex(list=getItemAtIndex_5, index=code_block_16)

watch_8 = Watch(getItemAtIndex_6)
to_number_python_3 = Python(IN[0]=watch_8)  # same code as to_number_python

# group: HP FROM EXCEL
code_block_17 = CodeBlock { 26; }
getItemAtIndex_7 = List.GetItemAtIndex(list=getItemAtIndex_5, index=code_block_17)

watch_9 = Watch(getItemAtIndex_7)
to_number_python_4 = Python(IN[0]=watch_9)  # same code as to_number_python

# group: Phase FROM EXCEL
code_block_18 = CodeBlock { 24; }
getItemAtIndex_8 = List.GetItemAtIndex(list=getItemAtIndex_5, index=code_block_18)

watch_10 = Watch(getItemAtIndex_8)
to_number_python_5 = Python(IN[0]=watch_10)  # same code as to_number_python

# group: Voltage FROM EXCEL
code_block_19 = CodeBlock { 22; }
getItemAtIndex_9 = List.GetItemAtIndex(list=getItemAtIndex_5, index=code_block_19)

watch_11 = Watch(getItemAtIndex_9)
to_number_python_6 = Python(IN[0]=watch_11)  # same code as to_number_python
code_block_20 = CodeBlock { 15; }
getItemAtIndex_10 = List.GetItemAtIndex(list=transpose, index=code_block_20)

# group: Connection Type FROM EXCEL
code_block_21 = CodeBlock { 30; }
getItemAtIndex_11 = List.GetItemAtIndex(list=getItemAtIndex_10, index=code_block_21)

watch_12 = Watch(getItemAtIndex_11)

# group: Write electrical Parameter in family
setParameterByName_4 = Element.SetParameterByName(element=type, parameterName=code_block.out15, value=to_number_python_3)
setParameterByName_5 = Element.SetParameterByName(element=type, parameterName=code_block.out18, value=to_number_python_4)
setParameterByName_6 = Element.SetParameterByName(element=type, parameterName=code_block.out16, value=to_number_python_5)
setParameterByName_7 = Element.SetParameterByName(element=type, parameterName=code_block.out17, value=to_number_python_6)
setParameterByName_8 = Element.SetParameterByName(element=type, parameterName=code_block.out19, value=watch_12)

setParameterByName_9 = Element.SetParameterByName(element=type, parameterName=code_block.out19, value=watch_12)
code_block_22 = CodeBlock { "hare "; "ram"; "ram hari hari "; }
concat_3 = Python(IN[0]=code_block_22.out0, IN[1]=code_block_22.out1, IN[2]=code_block_22.out2)
# ---------- concat_3.python (11 lines) ----------
#import os

#os.path.exists("python script for file.exits or not")

a = IN[0]
b = IN[1]
c = IN[2]

d = a+b+c

OUT=d
# ----------------------------------------
watch_13 = Watch(concat_3)
watch_14 = Watch(fromPath_2)
code_block_23 = CodeBlock { 14; }
getItemAtIndex_12 = List.GetItemAtIndex(list=transpose, index=code_block_23)

# group: LENGTH FROM EXCEL
code_block_24 = CodeBlock { 22; }
getItemAtIndex_13 = List.GetItemAtIndex(list=getItemAtIndex_12, index=code_block_9)

watch_15 = Watch(getItemAtIndex_13)
code_block_25 = CodeBlock { 100; 200; 345; 34; 343455; 345; 324525; 234234; 29; 290; 243; 52; }

# group: String To number and change into feet
script = Python(IN[0]=watch_15, IN[1]=watch_3, IN[2]=watch_4, IN[3]=code_block_25.out0, IN[4]=code_block_25.out0, IN[5]=code_block_25.out1, IN[6]=code_block_25.out1, IN[7]=code_block_25.out1, IN[8]=code_block_25.out1, IN[9]=code_block_25.out1, IN[10]=code_block_25.out7, IN[11]=code_block_25.out8)
# ---------- script.python (24 lines) ----------
x = []
identityData = []
electricalData = []
j=0

# For convert into float and convert into feet
def converter(i):
	data = float(IN[i])
	convert= data/12
	return convert

#append data into array x 
while j<10:
	
	if j<5:
		identityData.append(converter(j))
		j+=1
	else:
		electricalData.append(converter(j))
		j+=1
x.append(identityData)
x.append(electricalData)

OUT = x
# ----------------------------------------

code_block_26 = CodeBlock { 0; }
getItemAtIndex_14 = List.GetItemAtIndex(list=script, index=code_block_26)
code_block_27 = CodeBlock { 0; }
getItemAtIndex_15 = List.GetItemAtIndex(list=getItemAtIndex_14, index=code_block_27)
python_script_2 = Python(IN[0]=watch_15, IN[1]=watch_3, IN[2]=watch_4, IN[3]=code_block_25.out0, IN[4]=code_block_25.out3, IN[5]=code_block_25.out5, IN[6]=code_block_25.out9, IN[7]=code_block_25.out10, IN[8]=code_block_25.out11, IN[9]=code_block_25.out4, IN[10]=type)
# ---------- python_script_2.python (47 lines) ----------
import clr
clr.AddReference('RevitNodes')


import Revit
clr.ImportExtensions(Revit.Elements)
clr.ImportExtensions(Revit.GeometryConversion)
clr.AddReference('RevitServices')


import RevitServices
from RevitServices.Persistence import DocumentManager
from RevitServices.Transactions import TransactionManager
from System.Collections.Generic import *
doc = DocumentManager.Instance.CurrentDBDocument


elements=IN[10]

x = []
identityData = []
electricalData = []
j=0

# For convert into float and convert into feet
def converter(i):
	data = float(IN[i])
	convert= data/12
	return convert

#append data into array x 
while j<10:
	
	if j<5:
		identityData.append(converter(j))
		j+=1
	else:
		electricalData.append(converter(j))
		j+=1
x.append(identityData)
x.append(electricalData)

elements.SetParameterByName("LENGTH",identityData[0])
elements.SetParameterByName("WIDTH",identityData[1])
elements.SetParameterByName("HEIGHT",identityData[2])

OUT = x
# ----------------------------------------
